# Grasshopper definition 03 hopes.ghx (Grasshopper 1.0.7)
# plug-ins: LunchBox

# ----
# input
number_slider = Slider(0.1, range=0..1)

U = GetInteger(Slider(15, range=0..100), AtLeast=1, AtMost=1, Maximum=2147483647, Minimum=-2147483648)
V = GetInteger(Slider(20, range=0..100), AtLeast=1, AtMost=1, Maximum=2147483647, Minimum=-2147483648)
deepth = GetNumber(Slider(0.23, range=0..1), AtLeast=1, AtMost=1, Maximum=1.797693135e+308, Minimum=-1.797693135e+308)
min = GetNumber(number_slider, AtLeast=1, AtMost=1, Maximum=1.797693135e+308, Minimum=-1.797693135e+308)
max = GetNumber(Slider(0.68, range=0..1), AtLeast=1, AtMost=1, Maximum=1.797693135e+308, Minimum=-1.797693135e+308)

planesrf = PlaneSurface(Plane=PlaneXY(0, 0, 0), XSize=Domain(0, 39), YSize=Domain(0, 20))
diamond = DiamondPanels(Surface=planesrf, UDivisions=U, VDivisions=V)  # -> DiamondPanels, TriPanels
explode = Explode(Curve=planesrf, Recursive=True)  # -> Segments, Vertices
crv = Curve(diamond.DiamondPanels)
item = ListItem(List=explode.Segments, Index=0, Wrap=True)
area = Area(Geometry=crv)  # -> Area, Centroid
pull = PullPoint(Point=area.Centroid, Geometry=item, ClosestOnly=True)  # -> ClosestPoint, Distance
num = Number(pull.Distance)
bnd = Bounds(Numbers=flatten(num))
remap = RemapNumbers(Value=num, Source=bnd, Target=Domain(0, 1))  # -> Mapped, Clipped
graph = GraphMapper(remap.Mapped, x0=0, x1=1, y0=0, y1=1, container_name="Bezier", cpx=[0, 0.25, 0.75, 1], cpy=[0, 0.25, 0.75, 1])
dom = ConstructDomain(DomainStart=min, DomainEnd=max)
remap_2 = RemapNumbers(Value=graph, Source=Domain(0, 1), Target=dom)  # -> Mapped, Clipped
multiplication = Multiplication(A=remap_2.Mapped, B=deepth)
scale = Scale(Geometry=crv, Center=area.Centroid, Factor=remap_2.Mapped)  # -> Geometry, Transform
Z = UnitZ(Factor=multiplication)
rev = Reverse(Vector=Z)
move = Move(Geometry=scale.Geometry, Motion=rev)  # -> Geometry, Transform
merge = Merge(Data1=graft(crv), Data2=graft(move.Geometry))
loft = Loft(Curves=merge, Options={Adjust=False, Closed=False, LoftEnds=0, LoftSimp=0, LoftType=0, Rebuild=10, Refit=0.01})

# ----
# output
brep = Brep(flatten(loft))
context_bake = ContextBake(Geometry=brep)
